# Dynamo graph Example.dyn (Dynamo 1.2.1.3083)

file_path = Filename("C:\Users\MThumfart\Documents\GitHub\DynamoPDF\Testfiles\Document1.pdf")
getAnnotationsFromPDF = DynamoPDF.Parser.GetAnnotationsFromPDF(file_path)
getAnnotation = DynamoPDF.Parser.GetAnnotation(getAnnotationsFromPDF)
watch = Watch(getAnnotation.out2)
firstItem = List.FirstItem(getAnnotation.out4)
code_block = CodeBlock { -200; }
extrudeAsSolid = Curve.ExtrudeAsSolid(firstItem, code_block)
